# Dynamo graph ELE_CogoPoints.dyn (Dynamo 3.5.2.8914)

# group: Frames
categories = Categories("OST_GenericModel")
all_elements_of_category = ElementsOfCategory(Category=categories)
string_from_object = FromObject(object=all_elements_of_category)
code_block = CodeBlock { "Frame"; }
contains = String.Contains(string=string_from_object, searchFor=code_block)
filterByBoolMask = List.FilterByBoolMask(list=all_elements_of_category, mask=contains)
code_block_2 = CodeBlock(t1=filterByBoolMask.in) { t2 = Revit.Element.Geometry(t1); }
code_block_3 = CodeBlock { 1; 0; }
getItemAtIndex = List.GetItemAtIndex(list=code_block_2@L2, index=code_block_3.out1)
getItemAtIndex_2 = List.GetItemAtIndex(list=code_block_2@L2, index=code_block_3.out0)
intersect = Geometry.Intersect(geometry=getItemAtIndex, other=getItemAtIndex_2)
flatten = List.Flatten(list=intersect)
python_script = Python(IN[0]=flatten)  # CPython3
# ---------- python_script.python (47 lines) ----------
import clr
clr.AddReference('RevitServices')
import RevitServices 
from RevitServices.Persistence import DocumentManager
doc = DocumentManager.Instance.CurrentDBDocument

clr.AddReference('RevitNodes')
import Revit
clr.ImportExtensions(Revit.GeometryConversion)

clr.AddReference('RevitAPI')
import Autodesk
from Autodesk.Revit.DB import FilteredElementCollector, BuiltInCategory

# Create a list object from singleton...
def tolist(obj1):
    if hasattr(obj1,"__iter__"): return obj1
    else: return [obj1]
    
# Convert Point from  Internal to Shared Coordinates...
def ToSharedCoordinates(pt):
    pt = doc.ActiveProjectLocation.GetTotalTransform().Inverse.OfPoint(pt).ToPoint()
    return pt

# Convert Point from Relative to Project Coordinates...
def ToProjectCoordinates(pt,pbp):
    pt = pt.Subtract(pbp).ToPoint()
    return pt

# Input Variables...
pts = tolist(IN[0])
# Output Variables...
shared, project, relative = [], [], []

# Collect Project Basepoint...
basePt = FilteredElementCollector(doc).OfCategory(BuiltInCategory.OST_ProjectBasePoint).FirstElement()
pbp = basePt.get_BoundingBox(None).Min

for pt in pts:
    # Convert point to Shared Coordinates...
    shared.append(ToSharedCoordinates(pt.ToXyz()))
    # Convert point to Project Coordinates...
    project.append(ToProjectCoordinates(pt.ToXyz(),pbp))
    # Point is already Relative to the Internal Origin...
    relative.append(pt)
     
OUT = shared, project, relative
# ----------------------------------------
code_block_4 = CodeBlock(x=python_script) { x[0]; x[1]; x[2]; }
list_create = List.Create(item0=filterByBoolMask.in)
name = Family.Name(family=list_create)
flatten_2 = List.Flatten(list=name)
python_script_2 = Python(IN[0]=code_block_4.out0, IN[1]=flatten_2)  # CPython3
# ---------- python_script_2.python (15 lines) ----------
# Entradas:
points = IN[0]  # Lista de puntos (cada uno con .X, .Y, .Z)
names = IN[1]   # Lista de nombres, misma longitud que points

# Verificamos que las listas tengan igual largo
if len(points) != len(names):
    raise Exception("Las listas de puntos y nombres no tienen la misma longitud.")

result = []

for pt, name in zip(points, names):
    # Extraemos coordenadas y nombre
    result.append([pt.X, pt.Y, pt.Z, name])

OUT = result
# ----------------------------------------
directory_path = Directory("C:\Users\p.rojas\OneDrive - Webuild Spa - Projects\SB\06 Dynamo\xml")  # graph input
code_block_5 = CodeBlock { "Cogo_points_Frames"; }
python_script_3 = Python(IN[0]=python_script_2, IN[1]=directory_path, IN[2]=code_block_5)  # CPython3; frozen
# ---------- python_script_3.python (74 lines) ----------
import os
from datetime import datetime

# Entradas
points = IN[0]  # Lista de puntos [(x,y,z,name), ...]
folder_path = IN[1]  # Carpeta donde guardar
custom_filename = IN[2] if len(IN) > 2 and IN[2] else None  # Nombre personalizado opcional

# Generar nombre de archivo
if custom_filename:
    if not custom_filename.endswith('.xml'):
        filename = custom_filename + '.xml'
    else:
        filename = custom_filename
else:
    timestamp = datetime.now().strftime("%Y%m%d_%H%M%S")
    filename = f"COGO_Points_{timestamp}.xml"

# Ruta completa
full_path = os.path.join(folder_path, filename)

# Crear carpeta si no existe
try:
    if not os.path.exists(folder_path):
        os.makedirs(folder_path)
except Exception as e:
    OUT = f"Error creando carpeta: {str(e)}"

# Generar XML en formato LandXML 1.2 para Civil 3D
try:
    # Obtener la fecha y hora actual
    current_datetime = datetime.now()
    date_str = current_datetime.strftime("%Y-%m-%d")
    time_str = current_datetime.strftime("%H:%M:%S")
    
    xml_content = '<?xml version="1.0"?>\n'
    xml_content += '<LandXML xmlns="http://www.landxml.org/schema/LandXML-1.2" xmlns:xsi="http://www.w3.org/2001/XMLSchema-instance" xsi:schemaLocation="http://www.landxml.org/schema/LandXML-1.2 http://www.landxml.org/schema/LandXML-1.2/LandXML-1.2.xsd" '
    xml_content += f'date="{date_str}" time="{time_str}" version="1.2" language="English" readOnly="false">\n'
    
    # Unidades (basado en el ejemplo proporcionado)
    xml_content += '\t<Units>\n'
    xml_content += '\t\t<Metric areaUnit="squareMeter" linearUnit="meter" volumeUnit="cubicMeter" temperatureUnit="celsius" pressureUnit="milliBars" diameterUnit="millimeter" angularUnit="decimal degrees" directionUnit="decimal degrees"></Metric>\n'
    xml_content += '\t</Units>\n'
    
    # Sistema de coordenadas (basado en el ejemplo proporcionado)
    xml_content += '\t<CoordinateSystem desc="EUREF89 Norwegian Transverse Mercator, Zone 5" ogcWktCode="PROJCS[&quot;EUREF89.NTM-5&quot;,GEOGCS[&quot;LL-ETRS89&quot;,DATUM[&quot;ETRS89&quot;,SPHEROID[&quot;WGS84&quot;,6378137.000,298.25722356],TOWGS84[0.0000,0.0000,0.0000,0.000000,0.000000,0.000000,0.00000000]],PRIMEM[&quot;Greenwich&quot;,0],UNIT[&quot;Degree&quot;,0.017453292519943295]],PROJECTION[&quot;Transverse_Mercator&quot;],PARAMETER[&quot;false_easting&quot;,100000.000],PARAMETER[&quot;false_northing&quot;,1000000.000],PARAMETER[&quot;scale_factor&quot;,1.000000000000],PARAMETER[&quot;central_meridian&quot;,5.50000000000000],PARAMETER[&quot;latitude_of_origin&quot;,58.00000000000000],UNIT[&quot;Meter&quot;,1.00000000000000]]" horizontalDatum="ETRS89" horizontalCoordinateSystemName="EUREF89.NTM-5" fileLocation="AutoCAD Map Zone Name"></CoordinateSystem>\n'
    
    # Información de la aplicación
    xml_content += '\t<Application name="Autodesk Civil 3D" desc="Civil 3D" manufacturer="Autodesk, Inc." version="2023" manufacturerURL="www.autodesk.com/civil" timeStamp="' + current_datetime.strftime("%Y-%m-%dT%H:%M:%S") + '"></Application>\n'
    
    # Sección de puntos
    xml_content += '\t<CgPoints>\n'
    
    for i, pt in enumerate(points, 1):
        x, y, z, name = pt
        # Formatear las coordenadas con precisión adecuada
        x_str = f"{x:.6f}".rstrip('0').rstrip('.') if '.' in f"{x:.6f}" else f"{x:.6f}"
        y_str = f"{y:.6f}".rstrip('0').rstrip('.') if '.' in f"{y:.6f}" else f"{y:.6f}"
        z_str = f"{z:.6f}".rstrip('0').rstrip('.') if '.' in f"{z:.6f}" else f"{z:.6f}"
        
        # CAMBIO AQUÍ: Intercambio y_str y x_str para corregir la inversión
        xml_content += f'\t\t<CgPoint name="{i}" code="{name}">{y_str} {x_str} {z_str}</CgPoint>\n'
    
    xml_content += '\t</CgPoints>\n'
    xml_content += '</LandXML>'
    
    # Escribir archivo
    with open(full_path, 'w', encoding='utf-8') as f:
        f.write(xml_content)
    
    OUT = f"✅ XML en formato LandXML generado correctamente para Civil 3D:\n📁 Carpeta: {folder_path}\n📄 Archivo: {filename}\n🗂️ Ruta completa: {full_path}\n📊 Puntos exportados: {len(points)}"

except Exception as e:
    OUT = f"❌ Error generando XML: {str(e)}"
# ----------------------------------------
python_script_4 = Python(IN[0]=flatten)  # CPython3
# ---------- python_script_4.python (17 lines) ----------
# Recibimos la lista de puntos como entrada
# Suponiendo que 'points' es la lista de puntos que tienes en Dynamo
points = IN[0]

# Inicializamos las listas vacías para X, Y y Z
x_values = []
y_values = []
z_values = []

# Iteramos sobre los puntos y extraemos X, Y, Z
for point in points:
    x_values.append(point.X)
    y_values.append(point.Y)
    z_values.append(point.Z)

# Salidas: las tres listas
OUT = (x_values, y_values, z_values)
# ----------------------------------------
code_block_6 = CodeBlock { 0; 1; 2; }
X = List.GetItemAtIndex(list=python_script_4, index=code_block_6.out0)
Y = List.GetItemAtIndex(list=python_script_4, index=code_block_6.out1)
Z = List.GetItemAtIndex(list=python_script_4, index=code_block_6.out2)
byCoordinates = Point.ByCoordinates(x=X, y=Y, z=Z)
watch = Watch(code_block_4.out0)

categories_2 = Categories("OST_GenericModel")
all_elements_of_category_2 = ElementsOfCategory(Category=categories_2)
string_from_object_2 = FromObject(object=all_elements_of_category_2)
code_block_7 = CodeBlock { "Cabinet"; }
contains_2 = String.Contains(string=string_from_object_2, searchFor=code_block_7)
filterByBoolMask_2 = List.FilterByBoolMask(list=all_elements_of_category_2, mask=contains_2)
code_block_8 = CodeBlock(t1=filterByBoolMask_2.in) { t2 = Revit.Element.Geometry(t1); }
code_block_9 = CodeBlock { 1; 0; }
getItemAtIndex_3 = List.GetItemAtIndex(list=code_block_8@L2, index=code_block_9.out1)
getItemAtIndex_4 = List.GetItemAtIndex(list=code_block_8@L2, index=code_block_9.out0)
intersect_2 = Geometry.Intersect(geometry=getItemAtIndex_3, other=getItemAtIndex_4)
flatten_3 = List.Flatten(list=intersect_2)
python_script_5 = Python(IN[0]=flatten_3)  # CPython3; same code as python_script_4
code_block_10 = CodeBlock { 0; 1; 2; }
X_2 = List.GetItemAtIndex(list=python_script_5, index=code_block_10.out0)
Y_2 = List.GetItemAtIndex(list=python_script_5, index=code_block_10.out1)
Z_2 = List.GetItemAtIndex(list=python_script_5, index=code_block_10.out2)
byCoordinates_2 = Point.ByCoordinates(x=X_2, y=Y_2, z=Z_2)
python_script_6 = Python(IN[0]=flatten_3)  # CPython3; same code as python_script
code_block_11 = CodeBlock(x=python_script_6) { x[0]; x[1]; x[2]; }
list_create_2 = List.Create(item0=filterByBoolMask_2.in)
name_2 = Family.Name(family=list_create_2)
flatten_4 = List.Flatten(list=name_2)
python_script_7 = Python(IN[0]=code_block_11.out0, IN[1]=flatten_4)  # CPython3; same code as python_script_2
directory_path_2 = Directory("C:\Users\p.rojas\OneDrive - Webuild Spa - Projects\SB\06 Dynamo\xml")  # graph input
code_block_12 = CodeBlock { "Cogo_points_Frames"; }
python_script_8 = Python(IN[0]=python_script_7, IN[1]=directory_path_2, IN[2]=code_block_12)  # CPython3; frozen; same code as python_script_3
watch_2 = Watch(code_block_11.out0)
