# Dynamo graph Sheet_Renumber.dyn (Dynamo 3.3.0.6316)

code_block = CodeBlock { "Sheets"; }
byName = Category.ByName(name=code_block)
all_elements_of_category = ElementsOfCategory(Category=byName)
# note: Notas:
# 1- Ninguna número de lámina debe tener el caracter "#"
# 2- Escribir el nombre del parametro donde se encuentra la numeración de las láminas, depende del idioma de su revit
c_nombre_de_parámetro_revit = StringInput("Sheet Number")  # "C: Nombre de parámetro [Revit English : Sheet Number]"; graph input
code_block_2 = CodeBlock(A=c_nombre_de_parámetro_revit) { A; }
getParameterValueByName = Element.GetParameterValueByName(element=all_elements_of_category, parameterName=code_block_2)
a_letra_de_la_subdisciplina_a = StringInput("")  # "A: Letra de la subdisciplina a renumerar [Arquitectura : A]"; graph input
b_número_del_subconjunto_a = StringInput("")  # "B: Número del subconjunto a renumerar [100: 1]"; graph input
add = a_letra_de_la_subdisciplina_a + b_número_del_subconjunto_a
contains = String.Contains(string=getParameterValueByName, searchFor=add)
filterByBoolMask = List.FilterByBoolMask(list=all_elements_of_category, mask=contains)
sheetNumber = Sheet.SheetNumber()  # unwired: sheet
sortByFunction = List.SortByFunction(list=filterByBoolMask.in, sortFunction=sheetNumber)
number = DoubleInput(101)
count = List.Count(list=sortByFunction)
sequence = Sequence(start=number, amount=count)
add_2 = a_letra_de_la_subdisciplina_a + sequence
code_block_3 = CodeBlock { 0; "#"; }
insert = String.Insert(string=add_2, index=code_block_3.out0, toInsert=code_block_3.out1)
setParameterByName = Element.SetParameterByName(element=sortByFunction, parameterName=code_block_2, value=insert)
getParameterValueByName_2 = Element.GetParameterValueByName(element=setParameterByName, parameterName=code_block_2)
code_block_4 = CodeBlock { ""; }
replace = String.Replace(string=getParameterValueByName_2, searchFor=code_block_3.out1, replaceWith=code_block_4)
setParameterByName_2 = Element.SetParameterByName(element=setParameterByName, parameterName=code_block_2, value=replace)  # graph output
