# Dynamo graph Warnings.dyn (Dynamo 2.16.4.10216)

file_path = Filename("No file selected.")  # graph input
python_script = Python(IN[0]=file_path)  # CPython3
# ---------- python_script.python (102 lines) ----------
import clr
import sys
import os

# Referencias a Revit API y Dynamo
clr.AddReference("RevitServices")
import RevitServices
from RevitServices.Persistence import DocumentManager

clr.AddReference("RevitAPI")
from Autodesk.Revit.DB import *

# Librerías Python estándar para Excel
from openpyxl import load_workbook
from openpyxl.utils import get_column_letter

# Obtener documento activo y su ruta
doc = DocumentManager.Instance.CurrentDBDocument
revit_path = doc.PathName

# Input del nodo Dynamo (ruta del archivo .xlsx)
xlsx_path = IN[0]
if isinstance(xlsx_path, list):
    xlsx_path = xlsx_path[0]

# Diccionario de palabras clave con su clasificación
keyword_classification = {
    "duplicate":3,
    "identical instances":3,
    "overlap":2,
    "off axis":2,
    "unassociated":3,
    "not properly enclosed":3,
    "cannot maintain attachment":3,
    "ignored in calculations":3,
    "will not remain":3,
    "conflicts":3,
    "invalid":3,
    "cannot connect":3,
    "missing":2,
    "outside":2,
    "unused":1,
    "hidden":1,
    "slightly":2,
    "malformed":1,
    "not continuous":2,
    "ignorable":1,
    "leader":2,
    "no solid geometry":2,
    "duplicate mark":1,
    "duplicate number":1,
    "not editable":1,
    "not joined":1,
    "not closed":2,
    "exceeds":3,
    "less than minimum":3,
    "cannot reach":3
}

def classify_error(msg):
    msg_lower = msg.lower()
    max_class = 1
    for kw, cls in keyword_classification.items():
        if kw in msg_lower:
            if cls > max_class:
                max_class = cls
    return max_class

# Extraer warnings del documento
warnings = doc.GetWarnings()

# Preparar datos para Excel
data_rows = []
for warning in warnings:
    msg = warning.GetDescriptionText()
    element_ids = warning.GetFailingElements()
    element_ids_str = "; ".join(str(eid.IntegerValue) for eid in element_ids)
    classification = classify_error(msg)
    data_rows.append([revit_path, msg, element_ids_str, classification])

# Cargar workbook Excel existente
wb = load_workbook(xlsx_path)

# Revisar si existe la hoja "Warning"
if "Warning" in wb.sheetnames:
    ws = wb["Warning"]
    start_row = ws.max_row + 1  # donde empezamos a escribir nuevas filas (append)
else:
    ws = wb.create_sheet("Warning")
    # Escribir encabezados solo si se crea la hoja
    ws.append(["Revit File", "Error Message", "Elements and Ids", "Classification"])
    start_row = 2  # siguiente fila después de encabezados

# Agregar filas nuevas (append)
for row_data in data_rows:
    ws.append(row_data)

# Guardar cambios
wb.save(xlsx_path)

# Salida
OUT = "Archivo Excel actualizado con {} warnings (append si la hoja existía).".format(len(data_rows))
# ----------------------------------------
